% Simulink data dictionary data_state.sldd

input_data = Simulink.Bus()
  IS_TS_ON: boolean
  IS_ASMS_ON: boolean
  MISSON_STATUS: Enum: MISSION
  EBS: Enum: EBS_STATE

AS_STATE = enum(DefaultValue="AS_OFF", AddClassNameToEnumNames=true)
  AS_OFF = 0
  MANUAL = 1
  AS_READY = 2
  AS_DRIVING = 3
  AS_FINISHED = 4
  AS_EMERGENCY = 5

SB_STATE = enum(DefaultValue="UNAVAILABLE", AddClassNameToEnumNames=true)
  UNAVAILABLE = 0
  AVAILABLE = 1
  ENGAGED = 2

SA_STATE = enum(DefaultValue="UNAVAILABLE", AddClassNameToEnumNames=true)
  UNAVAILABLE = 0
  AVAILABLE = 1

ASSI_STATE = enum(DefaultValue="OFF", AddClassNameToEnumNames=true)
  OFF = 0
  READY = 1  % yellow continuous
  DRIVING = 2  % yellow flashing
  FINISHED = 3  % blue continuous
  EMERGENCY = 4  % blue flashing

EBS_STATE = enum(DefaultValue="UNAVAILABLE", AddClassNameToEnumNames=true)
  UNAVAILABLE = 0
  ARMED = 1
  ACTIVATED = 2

MISSION = enum(DefaultValue="MANUAL", AddClassNameToEnumNames=true)
  MISSION_OFF = 0
  MANUAL = 1
  AUTONOMOUS = 2